# Grasshopper definition RhinoLayer.gh (Grasshopper 1.0.7)

# create mesh from surface
panel = Panel("My New Layer")
panel_2 = Panel("ExportレイヤーをOBJとして書き出す")
panel_3 = Panel("レイヤーごとにメッシュを結合する")
panel_4 = Panel("レイヤーごとにOBJとして書き出す")
# オブジェクトのレイヤーを変更
# 可視レイヤーのオブジェクトだけレイヤーを移動
# （元の階層を保ったまま）
panel_5 = Panel("親レイヤー、子レイヤーを取得する")
# マテリアルをレイヤーに設定
panel_6 = Panel("My New Layer")
# レイヤーを取得
# レイヤーを新規作成
panel_7 = Panel("My New Layer")
# レイヤーに属するオブジェクトを取得
panel_8 = Panel("My New Layer")
create_layer = CSharpScript(LayerName=panel, TooltipDescriptionOverride="a", TooltipTextOverride="a")  # -> out, A; inputs LayerName: String
# ---------- create_layer: C# ----------
    var layer = RhinoDocument.Layers.FindName(LayerName);
    var objs = RhinoDocument.Objects.FindByLayer(layer);

    foreach(var obj in objs)
    {
      var geo = obj.Geometry as Surface;
      if(geo != null)
      {
        var mesh = Mesh.CreateFromSurface(geo);
        RhinoDocument.Objects.AddMesh(mesh);
      }
    }
    var opt = new Rhino.FileIO.FileWriteOptions();
    opt.SuppressDialogBoxes = false;
    RhinoDocument.WriteFile(@"C:\Users\murak\Desktop\tes.fbx", opt);
# ---------- end create_layer ----------
create_layer_2 = CSharpScript(TooltipDescriptionOverride="a", TooltipTextOverride="a")  # -> out, A
# ---------- create_layer_2: C# ----------
    var layers = RhinoDocument.Layers;
    Rhino.DocObjects.RhinoObject[] objs = RhinoDocument.Objects.FindByLayer(layers[0]); 
    A = objs;
# ---------- end create_layer_2 ----------
create_layer_3 = CSharpScript(LayerName=panel_8, TooltipDescriptionOverride="a", TooltipTextOverride="a")  # -> out, LayerObjects; inputs LayerName: String
# ---------- create_layer_3: C# ----------
    var layer = RhinoDocument.Layers.FindName(LayerName);
    LayerObjects = RhinoDocument.Objects.FindByLayer(layer);
# ---------- end create_layer_3 ----------
create_layer_4 = CSharpScript(LayerName=panel_6, TooltipDescriptionOverride="a", TooltipTextOverride="a")  # inputs LayerName: String
# ---------- create_layer_4: C# ----------
    var layer = RhinoDocument.Layers.FindName(LayerName);
    var index = RhinoDocument.Materials.Add();
    var mat = RhinoDocument.Materials[index];
    mat.Name = LayerName;
    mat.CommitChanges();


    layer.RenderMaterialIndex = index;
# ---------- end create_layer_4 ----------
create_layer_5 = CSharpScript(LayerName=panel_7, TooltipDescriptionOverride="a", TooltipTextOverride="a")  # inputs LayerName: String
# ---------- create_layer_5: C# usings ----------
using Rhino.DocObjects;
# ---------- create_layer_5: C# ----------
    var layer = new Layer();
    layer.Name = LayerName;
    layer.Color = System.Drawing.Color.SeaGreen;
    RhinoDocument.Layers.Add(layer);
# ---------- end create_layer_5 ----------
create_layer_6 = CSharpScript(FromName="My New Layer", ToName="To Layer", TooltipDescriptionOverride="a", TooltipTextOverride="a")  # inputs FromName: String, ToName: String
# ---------- create_layer_6: C# ----------
    var fromL = RhinoDocument.Layers.FindName(FromName);
    var toL = RhinoDocument.Layers.FindName(ToName);
    Rhino.DocObjects.RhinoObject[] objs = RhinoDocument.Objects.FindByLayer(fromL);
    foreach(var obj in objs)
    {
      obj.Attributes.LayerIndex = toL.Index;
      obj.CommitChanges();
    }
# ---------- end create_layer_6 ----------
c_script = CSharpScript()  # -> out, Layers
# ---------- c_script: C# usings ----------
using System.Linq;
# ---------- c_script: C# ----------
    Layers = RhinoDocument.Layers;
# ---------- end c_script ----------
c_script_2 = CSharpScript()  # -> out, Type
# ---------- c_script_2: C# ----------
      Type = RhinoDocument.Layers.GetType();
# ---------- end c_script_2 ----------
create_layer_7 = CSharpScript(TooltipDescriptionOverride="a", TooltipTextOverride="a")  # -> out, A; same code as create_layer_2
create_layer_8 = CSharpScript(TooltipDescriptionOverride="a", TooltipTextOverride="a")  # -> out, A; same code as create_layer_2
panel_9 = Panel(create_layer.A)
panel_10 = Panel(create_layer_2.A)
panel_11 = Panel(c_script.Layers)
panel_12 = Panel(c_script_2.Type)
panel_13 = Panel(create_layer_3.LayerObjects)
panel_14 = Panel(create_layer_7.A)
panel_15 = Panel(create_layer_8.A)
